# Grasshopper definition urban_inventory.gh (Grasshopper 1.0.8)

number_slider = Slider(40, range=0..100)
geo = Geometry([<curve referenced from the Rhino model> x5000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])
S = Script(curves=geo, sheet_width=Slider(6000, range=0..10000), row_spacing=number_slider, col_spacing=number_slider)  # -> out, sorted_curves, stats_text; inputs curves: list of Curve, sheet_width: Double, row_spacing: Double, col_spacing: Double, sort_mode: String, scale_factor: Double, rotate_to_fit: Boolean
# ---------- S: Python ----------
#! python3
# r: Rhino
# r: Grasshopper

import Rhino
import Rhino.Geometry as rg
import math

# ── Inputs (el nuevo Script component los inyecta como variables globales) ────
# Manage inputs:
#   curves        Curve   List
#   sheet_width   Number  Item  (400)
#   row_spacing   Number  Item  (8)
#   col_spacing   Number  Item  (4)
#   sort_mode     Text    Item  ("area")
#   scale_factor  Number  Item  (1.0)
#   rotate_to_fit Boolean Item  (True)
#
# Manage outputs:
#   sorted_curves   Curve   List
#   areas           Number  List
#   ranks           Integer List
#   stats_text      Text    Item

# ── Utilidades ────────────────────────────────────────────────────────────────

def _area(c):
    if not c.IsClosed:
        return 0.0
    a = rg.AreaMassProperties.Compute(c)
    return abs(a.Area) if a else 0.0

def _bb(c):
    return c.GetBoundingBox(rg.Plane.WorldXY)

def _centrar(c):
    ctr = _bb(c).Center
    cc  = c.DuplicateCurve()
    cc.Transform(rg.Transform.Translation(-ctr.X, -ctr.Y, 0.0))
    return cc

def _rotar_min_width(c):
    best_w, best_a = float("inf"), 0.0
    for deg in range(0, 90, 3):
        rad = math.radians(deg)
        t   = c.DuplicateCurve()
        t.Transform(rg.Transform.Rotation(rad, rg.Vector3d.ZAxis, rg.Point3d.Origin))
        w   = _bb(t).Max.X - _bb(t).Min.X
        if w < best_w:
            best_w, best_a = w, rad
    r = c.DuplicateCurve()
    r.Transform(rg.Transform.Rotation(best_a, rg.Vector3d.ZAxis, rg.Point3d.Origin))
    return r

def _disponer(crvs, ws, hs, sheet_w, col_sp, row_sp):
    placed, cx, cy, row_h = [], 0.0, 0.0, 0.0
    for i, c in enumerate(crvs):
        w, h = ws[i], hs[i]
        if cx > 0 and (cx + w + col_sp) > sheet_w:
            cx, cy, row_h = 0.0, cy - row_h - row_sp, 0.0
        dup = c.DuplicateCurve()
        dup.Transform(rg.Transform.Translation(cx + w / 2.0, cy - h / 2.0, 0.0))
        placed.append(dup)
        cx   += w + col_sp
        row_h = max(row_h, h)
    return placed

# ── Leer inputs ───────────────────────────────────────────────────────────────

def _g(name, default):
    v = globals().get(name)
    return v if v is not None else default

_sw  = float(_g("sheet_width",   400.0))
_rsp = float(_g("row_spacing",   8.0))
_csp = float(_g("col_spacing",   4.0))
_sm  = str(_g("sort_mode",       "area")).lower().strip()
_sf  = float(_g("scale_factor",  1.0))
_rot = bool(_g("rotate_to_fit",  True))

# Normalizar curves a lista
_raw = globals().get("curves")
if _raw is None:
    _crv_list = []
elif hasattr(_raw, "AllData"):
    _crv_list = list(_raw.AllData(True))
elif isinstance(_raw, (list, tuple)):
    _crv_list = [c for c in _raw if c is not None]
else:
    _crv_list = [_raw]

# Filtrar curvas cerradas validas
valid = []
for _c in _crv_list:
    if not isinstance(_c, rg.Curve) or not _c.IsValid:
        continue
    _cc = _c.DuplicateCurve()
    if _sf != 1.0:
        _cc.Transform(rg.Transform.Scale(rg.Point3d.Origin, _sf))
    if _cc.IsClosed:
        valid.append(_cc)

# ── Computar ──────────────────────────────────────────────────────────────────

if not valid:
    sorted_curves = []
    areas         = []
    ranks         = []
    stats_text    = f"0 curvas cerradas. Recibidos: {len(_crv_list)} objetos."
else:
    _areas_v  = [_area(c)                     for c in valid]
    _perim_v  = [c.GetLength()                for c in valid]
    _widths_v = [_bb(c).Max.X - _bb(c).Min.X for c in valid]

    if _sm in ("perimeter", "perimetro"):
        _idx = sorted(range(len(valid)), key=lambda i: _perim_v[i],  reverse=True)
    elif _sm in ("width", "ancho"):
        _idx = sorted(range(len(valid)), key=lambda i: _widths_v[i], reverse=True)
    else:
        _idx = sorted(range(len(valid)), key=lambda i: _areas_v[i],  reverse=True)

    _centradas, _ws_c, _hs_c = [], [], []
    for i in _idx:
        _c = _centrar(valid[i])
        if _rot:
            _c = _centrar(_rotar_min_width(_c))
        _b = _bb(_c)
        _ws_c.append(_b.Max.X - _b.Min.X)
        _hs_c.append(_b.Max.Y - _b.Min.Y)
        _centradas.append(_c)

    sorted_curves = _disponer(_centradas, _ws_c, _hs_c, _sw, _csp, _rsp)
    areas         = [_areas_v[i]  for i in _idx]
    ranks         = list(range(1, len(_idx) + 1))

    _n  = len(areas)
    _st = sum(areas)
    stats_text = (
        f"MORALEJA DE ENMEDIO\n"
        f"n = {_n}  |  S total = {_st:,.1f} m2  |  S media = {_st/_n:,.1f} m2\n"
        f"S max = {max(areas):,.1f} m2  |  S min = {min(areas):,.1f} m2\n"
        f"Orden: {_sm}  |  panel: {_sw}  |  sep H/V: {_csp}/{_rsp}\n"
        f"d'apres Armelle Caron - les villes rangees"
    )

print(stats_text)
# ---------- end S ----------
panel = Panel(S.sorted_curves)
